# Dynamo graph Dyn_06_DesignScript and Code Block_sol.dyn (Dynamo 2.12.1.8246)

# note: Important stuff
# Purple will indicate something important is going on here.
# note: Checking / Outputs
# Orange indicates checking nodes to ensure the script has deployed correctly.
# note: Working / Functions
# Green indicates the working of the script. No changes should be made in these groups unless advised.
# note: Variables / Inputs
# Red indicates Variables that can be altered per project and must be set accordingly before running the script.

# group: Dyn_06_DesignScript and Code Block
# note: Contents
# 1. Codeblock (accepting all kind of Data)
# 2. Statements in CodeBlock
# 	• Implied Statements (no input needed)
# 	• Statements (input, multiline)
# 3. Booleans in CodeBlock
# 4. NodeToCode
# 	• Point.ByCoordinates(x,y,z)
# 	• Inputs + Points (single and lists)
# 5. Range function (CodeBlock vs DesignScript)
# 6. Sequence function (CodeBlock vs DesignScript)
# 7. Complex example:
# 	• Range, Picking an item from list, transpose
# 8. Lists in Codeblock [1,2,3]
# 9. Dicitionaries {key:value}
# 10. Functions
#  	def name(input)
# 	{
# 	return =  value
# 	}

# group: Code Blocks
# note: It accepts all kind of types
# note: 1. Code Block
code_block = CodeBlock { 2; }
code_block_2 = CodeBlock { 1.0; }
code_block_3 = CodeBlock { "String"; }
code_block_4 = CodeBlock { true; }
code_block_5 = CodeBlock { false; }
code_block_6 = CodeBlock { 2; 1.0; "String"; true; false; }

# group: Implied statements
# note: 2. Statements in Code block
code_block_7 = CodeBlock { x=5; }
code_block_8 = CodeBlock { 2+2; }

# group: Checking output
watch = Watch()  # unwired: arg0

# note: can feed a list!
code_block_9 = CodeBlock { [1,3]; }
code_block_10 = CodeBlock { 1; 2; }
code_block_11 = CodeBlock { 1; 2; }

# group: Statments
code_block_12 = CodeBlock(x=code_block_9) { x+5; }
code_block_13 = CodeBlock(x=code_block_10.out0, y=code_block_10.out1) { x+y; }
code_block_14 = CodeBlock(x=code_block_11.out0, y=code_block_11.out1) { x; x+y; x*y; x-y; }

# note: 3. Booleans
code_block_15 = CodeBlock { 5; }

# group: Booleans
code_block_16 = CodeBlock(x=code_block_15) { x==5; x!=5; x>5; x<5; x>=5; x<=5; }

# group: Node to Code
# note: 4. Node to Code
code_block_17 = CodeBlock { 5; }
byCoordinates = Point.ByCoordinates(x=code_block_17, y=code_block_17, z=code_block_17)
point = CodeBlock(x=code_block_17, y=code_block_17, z=code_block_17) { Point.ByCoordinates(x,y,z); }

# group: Range
# note: 5. Range
code_block_18 = CodeBlock { 1; 10; }
range = Range(start=code_block_18.out0, end=code_block_18.out1, step=code_block_18.out0)
range_2 = CodeBlock { 1..20..2; }
code_block_19 = CodeBlock { 25; }
# note: start,stop,step
range_3 = CodeBlock(x=code_block_19) { 1..x..1; }

# group: Sequence
# note: 6. Sequence
code_block_20 = CodeBlock { 1; 10; }
sequence = Sequence(start=code_block_20.out0, amount=code_block_20.out1, step=code_block_20.out0)
sequence_2 = CodeBlock { 1..#20..2; }

# group: Complex example
# note: 7. Complex example
code_block_21 = CodeBlock { 1; 10; }
range_4 = Range(start=code_block_21.out0, end=code_block_21.out1, step=code_block_21.out0)
code_block_22 = CodeBlock { 5; }
getItemAtIndex = List.GetItemAtIndex(list=range_4, index=code_block_22)
transpose = List.Transpose(lists=getItemAtIndex)
code_block_23 = CodeBlock { range = 1..10..1; item = List.GetItemAtIndex(range,5); List.Transpose(item); }
watch_2 = Watch(code_block_23.out2)

# group: Lists
# note: 8. Lists
code_block_24 = CodeBlock { [1,2,3]; }
code_block_25 = CodeBlock { str1="st1"; str2="st2"; str3="st3"; [str1,str2,str3]; }

# group: Functions
# note: 10. Functions
code_block_26 = CodeBlock()
# ---------- code_block_26.designscript (5 lines) ----------
def squared(input)
{
//explanantion text
return = input*input;
};
# ----------------------------------------
code_block_27 = CodeBlock { 5; }
code_block_28 = CodeBlock(x=code_block_27) { squared(x); }

# group: Inputs + Point
point_2 = CodeBlock { x = [1,2,3]; y = [1,2,3]; z = [1,2,3]; Point.ByCoordinates(x,y,z); }
point_3 = CodeBlock { x = [10]; y = [20]; z = [30]; Point.ByCoordinates(x,y,z); }

# group: Dictionaries
# note: 9. Dictionary
code_block_29 = CodeBlock()
# ---------- code_block_29.designscript (5 lines) ----------
{
"key1":"value1",
"key2":"value2",
"key3":"value3"
};
# ----------------------------------------
keys = DesignScript.Builtin.Dictionary.Keys(dictionary=code_block_29)
values = DesignScript.Builtin.Dictionary.Values(dictionary=code_block_29)
code_block_30 = CodeBlock { "key1"; }
valueAtKey = DesignScript.Builtin.Dictionary.ValueAtKey(dictionary=code_block_29, key=code_block_30)
