# Dynamo graph WIP_Dyn_16_SpatialPlanning From Excel.dyn (Dynamo 2.12.1.8246)

# note: Important stuff
# Purple will indicate something important is going on here.
# note: Checking / Outputs
# Orange indicates checking nodes to ensure the script has deployed correctly.
# note: Working / Functions
# Green indicates the working of the script. No changes should be made in these groups unless advised.
# note: Variables / Inputs
# Red indicates Variables that can be altered per project and must be set accordingly before running the script.

# group: Excel file!
# note: Needed Excel File for creating volumes!

# group: Dyn_13_Spatial Plan from Excel
# note: Workflow
# To be filled in!

# group: Family Name
family_name = CodeBlock { "A_VOL_Pièce_SurfaceFixe"; }

# group: File path
file_path = Filename(".\EPFL_Tableau SU_V02.xlsx")

# group: Excel Worksheet
excel_worksheet_name = CodeBlock { "XXX"; }

# group: Import Excel file
file_from_path = FileObject(path=file_path)
code_block = CodeBlock { true; false; }
importExcel = Data.ImportExcel(file=file_from_path, sheetName=excel_worksheet_name, readAsStrings=code_block.out0, showExcel=code_block.out1)

string_from_object = FromObject(object=importExcel)

# group: Clean Sheet Imported data (and repeat values based on instance)
code_block_2 = CodeBlock(input=string_from_object)
# ---------- code_block_2.designscript (14 lines) ----------
//Get Raw excel data
raw_excel = input;
headers = input[0];
drop_headers = List.DropItems(raw_excel,1);
transpose = List.Transpose(drop_headers);
clean_data = String.Replace(transpose, "null" ,"");

// Gettting All parmaeters
room_name = clean_data[0];
room_zoning = clean_data[1];
required_area = String.ToNumber(clean_data[2]);
room_instances = String.ToNumber(clean_data[3]);
room_height = String.ToNumber(clean_data[4]);
room_material = clean_data[8];
# ----------------------------------------

# group: Cycle Data based on Room Instances
code_block_3 = CodeBlock(instances=code_block_2.room_instances, room_name=code_block_2.room_name, room_zoning=code_block_2.room_zoning, required_area=code_block_2.required_area, room_height=code_block_2.room_height, room_material=code_block_2.room_material)
# ---------- code_block_3.designscript (12 lines) ----------
instances;

// Cycle and Flatten each sublist
u_room_name = List.Flatten(List.Cycle(room_name@L1<1>,instances@L1<1>));
u_room_zoning = List.Flatten(List.Cycle(room_zoning@L1<1>,instances@L1<1>));
u_required_area = List.Flatten(List.Cycle(required_area@L1<1>,instances@L1<1>));
u_room_height = List.Flatten(List.Cycle(room_height@L1<1>,instances@L1<1>));
u_room_material = List.Flatten(List.Cycle(room_material@L1<1>,instances@L1<1>));


updated_dataset = [u_room_name, u_room_zoning, u_required_area,
u_room_height, u_room_material];
# ----------------------------------------

# group: GroupKeys based on Zoning value
# note: Grouping Keys will be the value column used for grouping excel data
code_block_4 = CodeBlock(clean_data=code_block_3.updated_dataset, grouping_keys=code_block_3.u_room_zoning)
# ---------- code_block_4.designscript (7 lines) ----------
data = clean_data;
grouping_keys;

// Group keys by Zoning
grouped = List.GroupByKey(data<2>,grouping_keys);
groups = Dictionary.ValueAtKey(grouped, "groups" );
List.Transpose(groups);
# ----------------------------------------

# group: Work GroupedKeys Data
code_block_5 = CodeBlock(grouped_data=code_block_4.out4)
# ---------- code_block_5.designscript (12 lines) ----------
grouped_data;

//Get each data column
room_number = List.GetItemAtIndex(grouped_data@L3<1>,0);
room_zoning = List.GetItemAtIndex(grouped_data@L3<1>,1);
required_area = List.GetItemAtIndex(grouped_data@L3<1>,2);
room_height = List.GetItemAtIndex(grouped_data@L3<1>,3);
room_material = List.GetItemAtIndex(grouped_data@L3<1>,4);

// Getting Room side and Maxium values per Zone and total
side = Math.Round(Math.Sqrt(required_area * 1000000));
List.MaximumItem(List.Flatten(side)) + 1000;
# ----------------------------------------

# group: Create Placement Points Matrix
code_block_6 = CodeBlock(input=code_block_5.room_number) { List.Count(input@L2<1>); }
code_block_7 = CodeBlock(number=code_block_6, step=code_block_5.out7) { (0..#number..step); }
code_block_8 = CodeBlock(input=code_block_5.room_number) { List.Count(input); }
code_block_9 = CodeBlock(number=code_block_8, step=code_block_5.out7) { List.Flatten(0..#number..-step); }
code_block_10 = CodeBlock(x=code_block_7, y=code_block_9) { Point.ByCoordinates(x,y,0); }

# group: Check Point Matrix
watch = Watch(code_block_10)

# group: Place Family Instances at Points
code_block_11 = CodeBlock(fam_name=family_name) { FamilyType.ByName(fam_name); }
code_block_12 = CodeBlock(fam=code_block_11, point=watch) { FamilyInstance.ByPoint(fam,point); }

# group: Instances
instances = Watch(code_block_12)

flatten = List.Flatten(list=instances)

# group: Revit Shared Parameters
code_block_13 = CodeBlock()
# ---------- code_block_13.designscript (7 lines) ----------
"PP_10A_Code Service";
"PP_10S_Surface Programme";
"PP_10D_Programme Hauteur";
"PP_10D_Projet Largeur";
"PP_10D_Programme Longueur";

"PP_10M_Matériau";
# ----------------------------------------

# group: Get Model Materials
code_block_14 = CodeBlock { cat = Category.ByName("Materials"); ElementQueries.OfCategory(cat); }

# group: Compare Excel materials with Model Materials
code_block_15 = CodeBlock(materials=code_block_5.room_material, file_materials=code_block_14.out1)
# ---------- code_block_15.designscript (9 lines) ----------
// Inputs
material_list = List.Flatten(materials);
file_materials;

file_materials_name = file_materials.Name;


indices = List.IndexOf(file_materials_name, material_list);
List.GetItemAtIndex(file_materials, indices);
# ----------------------------------------

# group: Replace null values
code_block_16 = CodeBlock { ""; }
isNull = Object.IsNull()  # unwired: object
replaceByCondition = Replace(item=code_block_15.out4, replaceWith=code_block_16, condition=isNull)

# group: Check Parameters
watch_2 = Watch(code_block_5.room_number)
watch_3 = Watch(code_block_5.required_area)
watch_4 = Watch(code_block_5.room_height)
watch_5 = Watch(code_block_5.side)
watch_6 = Watch(replaceByCondition)

flatten_2 = List.Flatten(list=watch_2)
flatten_3 = List.Flatten(list=watch_3)
flatten_4 = List.Flatten(list=watch_4)
flatten_5 = List.Flatten(list=watch_5)

# group: Set Data for each instance
code_block_17 = CodeBlock(input=flatten, name_param=code_block_13.out0, area_param=code_block_13.out1, height_param=code_block_13.out2, width_param=code_block_13.out3, material_param=code_block_13.out5, input_name=flatten_2, input_area=flatten_3, input_height=flatten_4, input_width=flatten_5, input_material=watch_6)
# ---------- code_block_17.designscript (16 lines) ----------
// Inpus
families = input;
name_param;
area_param;
height_param;
width_param;
material_param;


//Set Parameters
Elements.Element.SetParameterByName(families, name_param, input_name);
Elements.Element.SetParameterByName(families, area_param, input_area);
Elements.Element.SetParameterByName(families, height_param, input_height);
Elements.Element.SetParameterByName(families, width_param, input_width);

Elements.Element.SetParameterByName(families, material_param, input_material);
# ----------------------------------------

watch_7 = Watch(code_block_15.material_list)
